# Grasshopper definition Lesson2.0.gh (Grasshopper 0.9.76)

panel = Panel(""""Lesson 2.0"

08/10/2017
Kristoffer Negendahl""")

# ---- group: Points
pt = Point(Tree({0}: [Point(-25.44568953, 14.31840102, 24.55278833), Point(-25.90253056, 9.201705722, 24.55278833), Point(-22.11685758, 5.554880647, 24.55278833), Point(-17.16661917, 3.57784377, 24.55278833), Point(-11.92908121, 2.553643623, 24.55278833), Point(-6.595117159, 2.386365046, 24.55278833), Point(-1.314639442, 3.144158174, 24.55278833), Point(3.621535482, 5.127888035, 24.55278833), Point(6.453910434, 9.369529014, 24.55278833), Point(6.108105857, 14.54284933, 24.55278833), Point(10.28823864, 17.75341379, 24.55278833)], {1}: [Point(-21.73431127, 11.87904028, 15.6167894), Point(-22.4040748, 6.184601225, 15.6167894), Point(-20.67952425, 0.7418060575, 15.6167894), Point(-16.71249572, -3.381099767, 15.6167894), Point(-11.48989373, -5.746120188, 15.6167894), Point(-5.772811496, -5.927016758, 15.6167894), Point(-0.555198061, -3.606347055, 15.6167894), Point(2.809428966, 0.9781234689, 15.6167894), Point(3.122215184, 6.662256501, 15.6167894), Point(3.141506027, 12.36373309, 15.6167894), Point(6.385546648, 17.0515894, 15.6167894)], {2}: [Point(-21.73431127, 11.87904028, -0.6950580859), Point(-22.4040748, 6.184601225, -0.6950580859), Point(-20.67952425, 0.7418060575, -0.6950580859), Point(-16.71249572, -3.381099767, -0.6950580859), Point(-11.48989373, -5.746120188, -0.6950580859), Point(-5.772811496, -5.927016758, -0.6950580859), Point(-0.555198061, -3.606347055, -0.6950580859), Point(2.809428966, 0.9781234689, -0.6950580859), Point(3.122215184, 6.662256501, -0.6950580859), Point(3.141506027, 12.36373309, -0.6950580859), Point(6.385546648, 17.0515894, -0.6950580859)]))

# ---- group: Lines
line = Line(Tree({0}: [Line((-25.44568953, 14.31840102, 24.55278833), (-25.90253056, 9.201705722, 24.55278833)), Line((-25.90253056, 9.201705722, 24.55278833), (-22.11685758, 5.554880647, 24.55278833)), Line((-22.11685758, 5.554880647, 24.55278833), (-17.16661917, 3.57784377, 24.55278833)), Line((-17.16661917, 3.57784377, 24.55278833), (-11.92908121, 2.553643623, 24.55278833)), Line((-11.92908121, 2.553643623, 24.55278833), (-6.595117159, 2.386365046, 24.55278833)), Line((-6.595117159, 2.386365046, 24.55278833), (-1.314639442, 3.144158174, 24.55278833))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], {1}: [Line((-21.73431127, 11.87904028, 15.6167894), (-22.4040748, 6.184601225, 15.6167894)), Line((-22.4040748, 6.184601225, 15.6167894), (-20.67952425, 0.7418060575, 15.6167894)), Line((-20.67952425, 0.7418060575, 15.6167894), (-16.71249572, -3.381099767, 15.6167894)), Line((-16.71249572, -3.381099767, 15.6167894), (-11.48989373, -5.746120188, 15.6167894)), Line((-11.48989373, -5.746120188, 15.6167894), (-5.772811496, -5.927016758, 15.6167894)), Line((-5.772811496, -5.927016758, 15.6167894), (-0.555198061, -3.606347055, 15.6167894))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], {2}: [Line((-21.73431127, 11.87904028, -0.6950580859), (-22.4040748, 6.184601225, -0.6950580859)), Line((-22.4040748, 6.184601225, -0.6950580859), (-20.67952425, 0.7418060575, -0.6950580859)), Line((-20.67952425, 0.7418060575, -0.6950580859), (-16.71249572, -3.381099767, -0.6950580859)), Line((-16.71249572, -3.381099767, -0.6950580859), (-11.48989373, -5.746120188, -0.6950580859)), Line((-11.48989373, -5.746120188, -0.6950580859), (-5.772811496, -5.927016758, -0.6950580859)), Line((-5.772811496, -5.927016758, -0.6950580859), (-0.555198061, -3.606347055, -0.6950580859))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]))

# ---- group: Curves
crv = Curve(Tree({0}: [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], {1}: [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], {2}: [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]))

# ----
srf = Surface(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)
brep = Brep(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)
mesh = Mesh(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)

# ---- group: Here we have 11 points in three lists
# Basic Lists and Trees
viewer = ParamViewer(pt)
# Notice we the three lists have indexes in curly brackets: {}
# We call these branches.
# {0} is the first branch and contains 11 points
viewer_2 = ParamViewer(pt)

# ----
# We can either use flatten or right click and flatten
line_2 = Line(flatten(line))
flatten = FlattenTree(Tree=line, Path="{0}")

# ---- group: Here we have 11 points in three lists
viewer_3 = ParamViewer(flatten)
# When we flatten the lists we get "a flat structure" only one list with all items (here 3x10 lines are flattened)
viewer_4 = ParamViewer(flatten)

# ----
# We can either use graft or right click and graft
pt_2 = Point(simplify(graft(pt)))
graft = GraftTree(Tree=flatten, IncludeEmptyLists=True, IncludeNullItems=True)  # -> simplify(Tree)
graft_2 = GraftTree(Tree=pt, IncludeEmptyLists=True, IncludeNullItems=True)  # -> simplify(Tree)
# We can either use graft or right click and graft
line_3 = Line(graft(line_2))

# ---- group: Here we have 11 points in three lists
viewer_5 = ParamViewer(graft)
# When we graft the lists we get "a grafted structure" only one item per list if we graft a flat list
viewer_6 = ParamViewer(graft)

viewer_7 = ParamViewer(graft_2)
# Notice what happens when we graft a structure with multiple lists
viewer_8 = ParamViewer(graft_2)

# ---- group: 0 means 1st
panel_2 = Panel("0")

# Notice what happens when we flatten the list before we chose a particular item
panel_3 = Panel("0")

# ---- group: Item in a list
item = ListItem(List=line, Index=panel_2, Wrap=True)

item_2 = ListItem(List=flatten(line), Index=panel_3, Wrap=True)

# ----
# There are many ways to retrieve data use branches when possible it is often a good idea to maintain the data structure.
panel_4 = Panel("{*;4}")

# ---- group: Masks w. *
split = SplitTree(Data=graft_2, Masks=flatten("{0;*}"))  # -> Positive, Negative

split_2 = SplitTree(Data=graft_2, Masks=flatten(panel_4))  # -> Positive, Negative

# ---- group: Item in list by branch
branch = TreeBranch(Tree=graft_2, Path="{0;4}", MaintainPaths=True)

# ----
panel_5 = Panel("""0
1""")

# ---- group: remove items with cull
cull_i = CullIndex(List=flatten(crv), Indices="1", Wrap=True)

# ---- group: cull with patterns
cull = CullPattern(List=flatten(split.Positive), CullPattern=panel_5)
