# Grasshopper definition Lesson2.1.gh (Grasshopper 0.9.76)

panel = Panel(""""Lesson 2.0"

08/10/2017
Kristoffer Negendahl""")

# ---- group: Points
pt = Point(Tree({0}: [Point(-25.44568953, 14.31840102, 24.55278833), Point(-25.90253056, 9.201705722, 24.55278833), Point(-22.11685758, 5.554880647, 24.55278833), Point(-17.16661917, 3.57784377, 24.55278833), Point(-11.92908121, 2.553643623, 24.55278833), Point(-6.595117159, 2.386365046, 24.55278833), Point(-1.314639442, 3.144158174, 24.55278833), Point(3.621535482, 5.127888035, 24.55278833), Point(6.453910434, 9.369529014, 24.55278833), Point(6.108105857, 14.54284933, 24.55278833), Point(10.28823864, 17.75341379, 24.55278833)], {1}: [Point(-21.73431127, 11.87904028, 15.6167894), Point(-22.4040748, 6.184601225, 15.6167894), Point(-20.67952425, 0.7418060575, 15.6167894), Point(-16.71249572, -3.381099767, 15.6167894), Point(-11.48989373, -5.746120188, 15.6167894), Point(-5.772811496, -5.927016758, 15.6167894), Point(-0.555198061, -3.606347055, 15.6167894), Point(2.809428966, 0.9781234689, 15.6167894), Point(3.122215184, 6.662256501, 15.6167894), Point(3.141506027, 12.36373309, 15.6167894), Point(6.385546648, 17.0515894, 15.6167894)], {2}: [Point(-21.73431127, 11.87904028, -0.6950580859), Point(-22.4040748, 6.184601225, -0.6950580859), Point(-20.67952425, 0.7418060575, -0.6950580859), Point(-16.71249572, -3.381099767, -0.6950580859), Point(-11.48989373, -5.746120188, -0.6950580859), Point(-5.772811496, -5.927016758, -0.6950580859), Point(-0.555198061, -3.606347055, -0.6950580859), Point(2.809428966, 0.9781234689, -0.6950580859), Point(3.122215184, 6.662256501, -0.6950580859), Point(3.141506027, 12.36373309, -0.6950580859), Point(6.385546648, 17.0515894, -0.6950580859)]))

# ---- group: Lines
line = Line(Tree({0}: [Line((-25.44568953, 14.31840102, 24.55278833), (-25.90253056, 9.201705722, 24.55278833)), Line((-25.90253056, 9.201705722, 24.55278833), (-22.11685758, 5.554880647, 24.55278833)), Line((-22.11685758, 5.554880647, 24.55278833), (-17.16661917, 3.57784377, 24.55278833)), Line((-17.16661917, 3.57784377, 24.55278833), (-11.92908121, 2.553643623, 24.55278833)), Line((-11.92908121, 2.553643623, 24.55278833), (-6.595117159, 2.386365046, 24.55278833)), Line((-6.595117159, 2.386365046, 24.55278833), (-1.314639442, 3.144158174, 24.55278833))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], {1}: [Line((-21.73431127, 11.87904028, 15.6167894), (-22.4040748, 6.184601225, 15.6167894)), Line((-22.4040748, 6.184601225, 15.6167894), (-20.67952425, 0.7418060575, 15.6167894)), Line((-20.67952425, 0.7418060575, 15.6167894), (-16.71249572, -3.381099767, 15.6167894)), Line((-16.71249572, -3.381099767, 15.6167894), (-11.48989373, -5.746120188, 15.6167894)), Line((-11.48989373, -5.746120188, 15.6167894), (-5.772811496, -5.927016758, 15.6167894)), Line((-5.772811496, -5.927016758, 15.6167894), (-0.555198061, -3.606347055, 15.6167894))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], {2}: [Line((-21.73431127, 11.87904028, -0.6950580859), (-22.4040748, 6.184601225, -0.6950580859)), Line((-22.4040748, 6.184601225, -0.6950580859), (-20.67952425, 0.7418060575, -0.6950580859)), Line((-20.67952425, 0.7418060575, -0.6950580859), (-16.71249572, -3.381099767, -0.6950580859)), Line((-16.71249572, -3.381099767, -0.6950580859), (-11.48989373, -5.746120188, -0.6950580859)), Line((-11.48989373, -5.746120188, -0.6950580859), (-5.772811496, -5.927016758, -0.6950580859)), Line((-5.772811496, -5.927016758, -0.6950580859), (-0.555198061, -3.606347055, -0.6950580859))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]))

# ---- group: Curves
crv = Curve(Tree({0}: [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], {1}: [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], {2}: [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]))

# ----
srf = Surface(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)
brep = Brep(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)
mesh = Mesh(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)
pdecon = Deconstruct(Point=flatten(pt))  # -> XComponent, YComponent, ZComponent
line_2 = Line(flatten(line))
panel_2 = Panel("Basic list operations")
len = Length(Curve=line_2)

# ---- group: bounds
# Find domain of list of numbers
bnd = Bounds(Numbers=flatten(pdecon.XComponent))

# ---- group: sort
# sort a list of numbers and sort same length list with items
sort = SortList(Keys=len, ValuesA=line_2)  # -> Keys, ValuesA

# ----
panel_3 = Panel(bnd)

# ---- group: first in list
item = ListItem(List=sort.Keys, Index="0", Wrap=True)

# ----
panel_4 = Panel("take first item")
# reverse list and take first item or last item from original list
rev = ReverseList(List=sort.Keys)

# ---- group: last in list
item_2 = ListItem(List=rev, Index="0", Wrap=True)

item_3 = ListItem(List=sort.Keys, Index="29", Wrap=True)

# shortcut to last item: -1
panel_5 = Panel("-1")
item_4 = ListItem(List=sort.Keys, Index=panel_5, Wrap=True)

# ----
panel_6 = Panel(item)
panel_7 = Panel("Make new domain")

# ---- group: construct domain
dom = ConstructDomain(DomainStart=Slider(0, range=0..100), DomainEnd=Slider(1, range=0..1))

# ---- group: Deconstruct domain
# Find min and max from list of numbers
dedomain = DeconstructDomain(Domain=bnd)  # -> Start, End

# ---- group: first in list
item_5 = ListItem(List=sort.ValuesA, Index="0", Wrap=True)

# ----
panel_8 = Panel(item_3)
panel_9 = Panel("shortest line")
panel_10 = Panel(item_2)
panel_11 = Panel(item_4)
panel_12 = Panel(dedomain.Start)
panel_13 = Panel(dedomain.End)
panel_14 = Panel(dom)
rev_2 = ReverseList(List=sort.ValuesA)
panel_15 = Panel(item_5)

# ---- group: last in list
item_6 = ListItem(List=rev_2, Index="0", Wrap=True)

# ----
panel_16 = Panel("longest line")
panel_17 = Panel(item_6)

# ---- group: remap numbers
# rescale list of numbers into new domain
remap = RemapNumbers(Value=pdecon.XComponent, Source=bnd, Target=dom)  # -> Mapped, Clipped

# ----
srf_2 = Surface(srf)
crv_2 = Curve(crv)
number_slider = Slider(14, range=2..20)
curvature = SurfaceCurvature(Surface=reparameterize(srf_2), Point="0.5,0.5")  # -> Frame, Gaussian, Mean
divide = DivideCurve(Curve=crv_2, Count=Slider(8, range=0..10), Kinks=False)  # -> Points, Tangents, Parameters

# ---- group: Duplicate any data n times
dup = DuplicateData(Data=curvature.Gaussian, Number=number_slider, Order=True)
viewer = ParamViewer(dup)

# ----
shatter = Shatter(Curve=crv_2, Parameters=divide.Parameters)  # -> simplify(Segments)
# create linear distributed set of numbers from domain
range = Range(Domain="0 to 2*pi", Steps=number_slider)
# use cull to remove same numbers (here 0 and 2pi is the same number when we revolve an item)
panel_18 = Panel("-1")

# ---- group: flip matrix
# flip matrix - flips the elements with the branches.
# Notice the amount of elements change
flip = FlipMatrix(Data=shatter)

# ---- group: Cull
cull_i = CullIndex(List=range, Indices=panel_18, Wrap=True)

# ---- group: Duplicate any data n times
dup_2 = DuplicateData(Data=viewer, Number=number_slider, Order=True)

# ----
item_7 = ListItem(List=shatter, Index=0, Wrap=True)
item_8 = ListItem(List=flip, Index=0, Wrap=True)
viewer_2 = ParamViewer(item_7)
viewer_3 = ParamViewer(item_8)
rotate = Rotate(Geometry=srf_2, Angle=graft(cull_i), Plane="{0,10,0}")  # -> simplify(Geometry), Transform
Z = UnitZ(Factor="10")
viewer_4 = ParamViewer(rotate.Geometry)
extr = Extrude(Base=item_7, Direction=Z)
extr_2 = Extrude(Base=item_8, Direction=Z)

# ---- group: Replace paths
# When we need data to be structured in a similar way as other data, this is a good way to do it. Notice the flatten input and the same amounts of elements represented in all inputs
replace = ReplacePaths(Data=flatten(rotate.Geometry), Search=viewer_4, Replace=dup_2)

# ----
srf_3 = Surface(replace)
viewer_5 = ParamViewer(srf_3)
