# Grasshopper definition Lesson3.0.gh (Grasshopper 0.9.76)

panel = Panel(""""Lesson 3.0"

08/10/2017
Kristoffer Negendahl""")

# ---- group: Points
pt = Point(Tree({0}: [Point(-25.44568953, 14.31840102, 24.55278833), Point(-25.90253056, 9.201705722, 24.55278833), Point(-22.11685758, 5.554880647, 24.55278833), Point(-17.16661917, 3.57784377, 24.55278833), Point(-11.92908121, 2.553643623, 24.55278833), Point(-6.595117159, 2.386365046, 24.55278833), Point(-1.314639442, 3.144158174, 24.55278833), Point(3.621535482, 5.127888035, 24.55278833), Point(6.453910434, 9.369529014, 24.55278833), Point(6.108105857, 14.54284933, 24.55278833), Point(10.28823864, 17.75341379, 24.55278833)], {1}: [Point(-21.73431127, 11.87904028, 15.6167894), Point(-22.4040748, 6.184601225, 15.6167894), Point(-20.67952425, 0.7418060575, 15.6167894), Point(-16.71249572, -3.381099767, 15.6167894), Point(-11.48989373, -5.746120188, 15.6167894), Point(-5.772811496, -5.927016758, 15.6167894), Point(-0.555198061, -3.606347055, 15.6167894), Point(2.809428966, 0.9781234689, 15.6167894), Point(3.122215184, 6.662256501, 15.6167894), Point(3.141506027, 12.36373309, 15.6167894), Point(6.385546648, 17.0515894, 15.6167894)], {2}: [Point(-21.73431127, 11.87904028, -0.6950580859), Point(-22.4040748, 6.184601225, -0.6950580859), Point(-20.67952425, 0.7418060575, -0.6950580859), Point(-16.71249572, -3.381099767, -0.6950580859), Point(-11.48989373, -5.746120188, -0.6950580859), Point(-5.772811496, -5.927016758, -0.6950580859), Point(-0.555198061, -3.606347055, -0.6950580859), Point(2.809428966, 0.9781234689, -0.6950580859), Point(3.122215184, 6.662256501, -0.6950580859), Point(3.141506027, 12.36373309, -0.6950580859), Point(6.385546648, 17.0515894, -0.6950580859)]))

# ---- group: Lines
line = Line(Tree({0}: [Line((-25.44568953, 14.31840102, 24.55278833), (-25.90253056, 9.201705722, 24.55278833)), Line((-25.90253056, 9.201705722, 24.55278833), (-22.11685758, 5.554880647, 24.55278833)), Line((-22.11685758, 5.554880647, 24.55278833), (-17.16661917, 3.57784377, 24.55278833)), Line((-17.16661917, 3.57784377, 24.55278833), (-11.92908121, 2.553643623, 24.55278833)), Line((-11.92908121, 2.553643623, 24.55278833), (-6.595117159, 2.386365046, 24.55278833)), Line((-6.595117159, 2.386365046, 24.55278833), (-1.314639442, 3.144158174, 24.55278833))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], {1}: [Line((-21.73431127, 11.87904028, 15.6167894), (-22.4040748, 6.184601225, 15.6167894)), Line((-22.4040748, 6.184601225, 15.6167894), (-20.67952425, 0.7418060575, 15.6167894)), Line((-20.67952425, 0.7418060575, 15.6167894), (-16.71249572, -3.381099767, 15.6167894)), Line((-16.71249572, -3.381099767, 15.6167894), (-11.48989373, -5.746120188, 15.6167894)), Line((-11.48989373, -5.746120188, 15.6167894), (-5.772811496, -5.927016758, 15.6167894)), Line((-5.772811496, -5.927016758, 15.6167894), (-0.555198061, -3.606347055, 15.6167894))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], {2}: [Line((-21.73431127, 11.87904028, -0.6950580859), (-22.4040748, 6.184601225, -0.6950580859)), Line((-22.4040748, 6.184601225, -0.6950580859), (-20.67952425, 0.7418060575, -0.6950580859)), Line((-20.67952425, 0.7418060575, -0.6950580859), (-16.71249572, -3.381099767, -0.6950580859)), Line((-16.71249572, -3.381099767, -0.6950580859), (-11.48989373, -5.746120188, -0.6950580859)), Line((-11.48989373, -5.746120188, -0.6950580859), (-5.772811496, -5.927016758, -0.6950580859)), Line((-5.772811496, -5.927016758, -0.6950580859), (-0.555198061, -3.606347055, -0.6950580859))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]))

# ---- group: Curves
crv = Curve(Tree({0}: [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], {1}: [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], {2}: [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]))

# ----
srf = Surface(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)
brep = Brep(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)
mesh = Mesh(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)
panel_2 = Panel("Basic Geometry generation")
item = ListItem(List=flatten(line), Index=Slider(45, range=0..100), Wrap=True)
item_2 = ListItem(List=pt, Index=0, Wrap=True)

# ---- group: Extrude 1 point
extr = ExtrudePoint(Base=item, Point=item_2)

# ----
Z = UnitZ(Factor=1)

# ---- group: Extrude crv
extr_2 = Extrude(Base=crv, Direction=Z)

# ----
crv_2 = Curve(crv)
range = Range(Domain=Domain(1, 5), Steps=10)
line_2 = LineSDL(Start=pt, Direction=Vector(0, 0, 1), Length=range)

# ---- group: Sweep
swp1 = Sweep1(Rail=crv_2, Sections=line_2, Miter=1)

# ----
loft = Loft(Curves=line_2, Options={Adjust=False, Closed=False, LoftEnds=0, LoftSimp=0, LoftType=0, Rebuild=10, Refit=0.01})
