# Grasshopper definition Lesson3.1.gh (Grasshopper 0.9.76)

panel = Panel(""""Lesson 3.1"

08/10/2017
Kristoffer Negendahl""")

# ---- group: Points
pt = Point(Tree({0}: [Point(-25.44568953, 14.31840102, 24.55278833), Point(-25.90253056, 9.201705722, 24.55278833), Point(-22.11685758, 5.554880647, 24.55278833), Point(-17.16661917, 3.57784377, 24.55278833), Point(-11.92908121, 2.553643623, 24.55278833), Point(-6.595117159, 2.386365046, 24.55278833), Point(-1.314639442, 3.144158174, 24.55278833), Point(3.621535482, 5.127888035, 24.55278833), Point(6.453910434, 9.369529014, 24.55278833), Point(6.108105857, 14.54284933, 24.55278833), Point(10.28823864, 17.75341379, 24.55278833)], {1}: [Point(-21.73431127, 11.87904028, 15.6167894), Point(-22.4040748, 6.184601225, 15.6167894), Point(-20.67952425, 0.7418060575, 15.6167894), Point(-16.71249572, -3.381099767, 15.6167894), Point(-11.48989373, -5.746120188, 15.6167894), Point(-5.772811496, -5.927016758, 15.6167894), Point(-0.555198061, -3.606347055, 15.6167894), Point(2.809428966, 0.9781234689, 15.6167894), Point(3.122215184, 6.662256501, 15.6167894), Point(3.141506027, 12.36373309, 15.6167894), Point(6.385546648, 17.0515894, 15.6167894)], {2}: [Point(-21.73431127, 11.87904028, -0.6950580859), Point(-22.4040748, 6.184601225, -0.6950580859), Point(-20.67952425, 0.7418060575, -0.6950580859), Point(-16.71249572, -3.381099767, -0.6950580859), Point(-11.48989373, -5.746120188, -0.6950580859), Point(-5.772811496, -5.927016758, -0.6950580859), Point(-0.555198061, -3.606347055, -0.6950580859), Point(2.809428966, 0.9781234689, -0.6950580859), Point(3.122215184, 6.662256501, -0.6950580859), Point(3.141506027, 12.36373309, -0.6950580859), Point(6.385546648, 17.0515894, -0.6950580859)]))

# ---- group: Lines
line = Line(Tree({0}: [Line((-25.44568953, 14.31840102, 24.55278833), (-25.90253056, 9.201705722, 24.55278833)), Line((-25.90253056, 9.201705722, 24.55278833), (-22.11685758, 5.554880647, 24.55278833)), Line((-22.11685758, 5.554880647, 24.55278833), (-17.16661917, 3.57784377, 24.55278833)), Line((-17.16661917, 3.57784377, 24.55278833), (-11.92908121, 2.553643623, 24.55278833)), Line((-11.92908121, 2.553643623, 24.55278833), (-6.595117159, 2.386365046, 24.55278833)), Line((-6.595117159, 2.386365046, 24.55278833), (-1.314639442, 3.144158174, 24.55278833))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], {1}: [Line((-21.73431127, 11.87904028, 15.6167894), (-22.4040748, 6.184601225, 15.6167894)), Line((-22.4040748, 6.184601225, 15.6167894), (-20.67952425, 0.7418060575, 15.6167894)), Line((-20.67952425, 0.7418060575, 15.6167894), (-16.71249572, -3.381099767, 15.6167894)), Line((-16.71249572, -3.381099767, 15.6167894), (-11.48989373, -5.746120188, 15.6167894)), Line((-11.48989373, -5.746120188, 15.6167894), (-5.772811496, -5.927016758, 15.6167894)), Line((-5.772811496, -5.927016758, 15.6167894), (-0.555198061, -3.606347055, 15.6167894))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], {2}: [Line((-21.73431127, 11.87904028, -0.6950580859), (-22.4040748, 6.184601225, -0.6950580859)), Line((-22.4040748, 6.184601225, -0.6950580859), (-20.67952425, 0.7418060575, -0.6950580859)), Line((-20.67952425, 0.7418060575, -0.6950580859), (-16.71249572, -3.381099767, -0.6950580859)), Line((-16.71249572, -3.381099767, -0.6950580859), (-11.48989373, -5.746120188, -0.6950580859)), Line((-11.48989373, -5.746120188, -0.6950580859), (-5.772811496, -5.927016758, -0.6950580859)), Line((-5.772811496, -5.927016758, -0.6950580859), (-0.555198061, -3.606347055, -0.6950580859))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]))

# ---- group: Curves
crv = Curve(Tree({0}: [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], {1}: [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], {2}: [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]))

# ----
srf = Surface(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)
brep = Brep(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)
mesh = Mesh(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)
len = Length(Curve=crv)
panel_2 = Panel(len)
# Control points on curv
panel_3 = Panel("Basic Geometry generation")
pline = PolyLine(Vertices=pt, Closed=False)

# ---- group: This is the original control points of the curve
cp = ControlPoints(Curve=reparameterize(crv))  # -> Points, Weights, Knots
nurbs = NurbsCurve(Vertices=cp.Points, Degree=3, Periodic=False)  # -> Curve, Length, Domain

# ----
# Notice how the rate of change is different when curves are nomalized (reparametized)
multiplication = Multiplication(A=Slider(0.54, range=0..1), B=panel_2)

# ---- group: Fast way to get midpoints
curvepoint = PointOnCurve(crv, parameter=0.5)

# ---- group: Evaluate crv
# Control points on surf
eval = EvaluateCurve(Curve=reparameterize(crv), Parameter=Slider(0.36, range=0..1))  # -> Point, Tangent, Angle
eval_2 = EvaluateCurve(Curve=crv, Parameter=multiplication)  # -> Point, Tangent, Angle

# ---- group: Discontinuity and endpoints
# Analyzing polylines discontionuities are good to understand
end = EndPoints(Curve=pline)  # -> Start, End
disc = Discontinuity(Curve=pline, Level=1)  # -> Points, Parameters

# ---- group: evaluate multiple points
range = Range(Domain=Domain(0, 1), Steps=10)
pt_2 = ConstructPoint(XCoordinate=graft(range), YCoordinate=range, ZCoordinate=0)  # -> flatten(Point)
evalsrf = EvaluateSurface(Surface=reparameterize(srf), Point=pt_2)  # -> Point, Normal, Frame

# ---- group: This is the original control points of the surface
srfpt = SurfacePoints(Surface=srf)  # -> Points, Weights, Greville, UCount, VCount
srfgrid = SurfaceFromPoints(Points=srfpt.Points, UCount=srfpt.UCount, Interpolate=srfpt.VCount)

# ---- group: midtpoint
evalsrf_2 = EvaluateSurface(Surface=reparameterize(srf), Point="0.5,0.5")  # -> Point, Normal, Frame

# ---- group: Normal
# Control points on breps
vec = Vector(evalsrf_2.Normal)

# ---- group: show normals
vdis = VectorDisplay(Anchor=evalsrf.Point, Vector=evalsrf.Normal)

# ----
debrep = DeconstructBrep(Brep=brep)  # -> Faces, Edges, Vertices

# ---- group: just a bunch of surfaces
# Control points on meshes
srf_2 = Surface(debrep.Faces)

# ---- group: Chose individual mesh elements
demesh = DeconstructMesh(Mesh=mesh)  # -> Vertices, graft(Faces), Colours, Normals
conmesh = ConstructMesh(Vertices=demesh.Vertices, Faces=demesh.Faces)  # -> flatten(Mesh)
weld = WeldMesh(Mesh=conmesh, Angle=3.141592654)
range_2 = Range(Domain=Domain(0, 500), Steps=300)
item = ListItem(List=weld, Index=range_2, Wrap=True)

# ---- group: The original mesh can be recreated when vertices and faces are known
demesh_2 = DeconstructMesh(Mesh=mesh)  # -> Vertices, Faces, Colours, Normals
conmesh_2 = ConstructMesh(Vertices=demesh_2.Vertices, Faces=demesh_2.Faces)

# ---- group: This is the new control points of the curve
cp_2 = ControlPoints(Curve=reparameterize(crv))  # -> Points, Weights, Knots

# ----
devec = DeconstructVector(Vector=cp_2.Points)  # -> XComponent, YComponent, ZComponent
jitter = Jitter(List=devec.YComponent, Jitter=0.1, Seed=2)  # -> Values, Indices
pt_3 = ConstructPoint(XCoordinate=devec.XComponent, YCoordinate=jitter.Values, ZCoordinate=devec.ZComponent)

# ---- group: This is the new control points of the curve (continued)
nurbs_2 = NurbsCurve(Vertices=pt_3, Degree=3, Periodic=False)  # -> Curve, Length, Domain

# ---- group: This is the new control points of the surface
srfpt_2 = SurfacePoints(Surface=srf)  # -> Points, Weights, Greville, UCount, VCount

# ----
devec_2 = DeconstructVector(Vector=srfpt_2.Points)  # -> XComponent, YComponent, ZComponent
jitter_2 = Jitter(List=devec_2.YComponent, Jitter=0.1, Seed=2)  # -> Values, Indices
pt_4 = ConstructPoint(XCoordinate=devec_2.XComponent, YCoordinate=jitter_2.Values, ZCoordinate=devec_2.ZComponent)

# ---- group: This is the new control points of the surface (continued)
srfgrid_2 = SurfaceFromPoints(Points=pt_4, UCount=srfpt_2.UCount, Interpolate=srfpt_2.VCount)
